# Grasshopper definition 20170307 GeoJSON.gh (Grasshopper 0.9.76)
# Copyright: Co-de-iT

panel = Panel("""Polygon to GeoJSON
0.1.3
 07/03/17""")
polygon_to_geojson_0_1_3 = PolygonToGeoJSON013()
panel_2 = Panel("""DeconstructExtrusion
0.1.1 
07/03/17""")
deconstructextrusion_0_1_1 = DeconstructExtrusion011()  # -> W, H_2, bh_2
panel_3 = Panel("""GeoJSON MERGE 
0.1
07/03/17""")
geojson_merge_0_1 = GeoJSONMERGE01()
panel_4 = Panel("""GeoJSONtoPolygon
0.1
 07/03/17""")
geojson_to_polygon_0_1 = GeoJSONToPolygon01()  # -> P_2, B_2, C_2, K_3, V_2

# ==== cluster GeoJSONMERGE01
data = ClusterInput()
data_2 = Data(data)
join = TextJoin(Text=data_2)
rep = ReplaceText(Text=join, Find="]}{\"type\":\"FeatureCollection\",\"features\":[", Replace=",", RecursiveReplace=False)
R = ClusterOutput(rep)

# ==== cluster PolygonToGeoJSON013
P = ClusterInput()
P_2 = Curve(P)
cp = ControlPoints(Curve=P_2)  # -> simplify(Points), Weights, Knots
V = ClusterInput()
K = ClusterInput()
V_2 = Data(simplify(V))
points_to_coordinates = PointsToCoordinates(P=cp.Points)
K_2 = Text(simplify(K))
flip = FlipMatrix(Data=V_2)

# ---- group: Keeps lists consistent lengths, repeating the last value for the total amount of keys
null = NullItem(Item=flip)  # -> NullFlags, InvalidFlags, Description
dispatch = Dispatch(List=flip, DispatchPattern=null.NullFlags)  # -> ListA, ListB
nullrep = ReplaceNulls(Items=flip, Replacements="█")  # -> simplify(Items), Count
index = ItemIndex(List=dispatch.ListB, Item=dispatch.ListB)
mindex = MemberIndex(Set=nullrep.Items, Member="█")  # -> Index, Count
item = ListItem(List=flip, Index=index, Wrap=True)
flip_2 = FlipMatrix(Data=item)
clean = CleanTree(RemoveNulls=True, RemoveInvalid=True, RemoveEmpty=False, Tree=flip_2)
item_2 = ListItem(List=clean, Index=0, Wrap=True)  # -> flatten(Item1), Item
item_3 = ListItem(List=item_2.Item1, Index=mindex.Index, Wrap=True)  # -> simplify(Item)
lng = ListLength(List=flatten(P_2))
replace = ReplaceItems(List=nullrep.Items, Item=item_3, Indices=mindex.Index, Wrap=False)  # -> simplify(List)
series = Series(Start=0, Step=1, Count=lng)
branch = TreeBranch(Tree=replace, Path=series, MaintainPaths=True)  # -> simplify(Branch)

# ----
rep = ReplaceText(Text="\"█\"", Find="█", Replace=K_2, RecursiveReplace=False)  # -> flatten(Result)
equals = Equality(FirstNumber=lng, SecondNumber=1)  # -> Equality, Inequality
mindex_2 = MemberIndex(Set=rep, Member="\"height\"")  # -> Index, Count
gate = StreamGate(Stream=replace, Gate=equals.Equality)  # -> Target0, Target1
rep_2 = ReplaceText(Text="{ \"type\": \"Polygon\",█}", Find="█", Replace=points_to_coordinates, RecursiveReplace=False)
filter = StreamFilter(Gate=equals.Inequality, Stream0=flatten(replace), Stream1=branch)
graft = GraftTree(Tree=K_2, IncludeEmptyLists=True, IncludeNullItems=True)  # -> simplify(flatten(Tree))

# ---- group: Polygon
flatten = FlattenTree(Tree=rep_2, Path="{0}")

# ----
mindex_3 = MemberIndex(Set=rep, Member="\"base_height\"")  # -> Index, Count
data = Data(filter)

# ---- group: height
item_4 = ListItem(List=data, Index=mindex_2.Index, Wrap=True)

# ---- group: base_height
item_5 = ListItem(List=data, Index=mindex_3.Index, Wrap=True)

# ----
addition = Addition(A=item_4, B=item_5)
rep_3 = ReplaceText(Text="{\"type\":\"Feature\",\"geometry\":█", Find="█", Replace=flatten, RecursiveReplace=False)
replace_2 = ReplaceItems(List=simplify(data), Item=addition, Indices=mindex_2.Index, Wrap=False)  # -> simplify(List)
json = JSON(Key=graft, Value=replace_2)  # -> simplify(flatten(JSON))
rep_4 = ReplaceText(Text=",\"properties\":█}", Find="█", Replace=json, RecursiveReplace=False)

# ---- group: Feature
concat = Concatenate(FragmentA=rep_3, FragmentB=rep_4)  # -> flatten(Result)

# ----
join = TextJoin(Text=concat, Join=",")
rep_5 = ReplaceText(Text="{\"type\":\"FeatureCollection\",\"features\":[█]}", Find="█", Replace=join, RecursiveReplace=False)
J = Text(rep_5)
J_2 = ClusterOutput(J)
panel = Panel(J)

# ==== cluster GeoJSONToPolygon01
J = ClusterInput()
J_2 = Text(J)
join = TextJoin(Text=graft(J_2))
panel = Panel("""features
geometry""")
gkeys = GETKEYS(object=join)  # -> simplify(value)
tmatch = MatchText(Text=graft(gkeys), Pattern=panel, Case=True)  # -> simplify(Match)
index = ItemIndex(List=tmatch, Item=tmatch)
int = Integer(tmatch)
dispatch = Dispatch(List=index, DispatchPattern=int)  # -> ListA, ListB
item = ListItem(List=dispatch.ListA, Index=0, Wrap=True)  # -> flatten(Item)
clean = CleanTree(RemoveNulls=True, RemoveInvalid=True, RemoveEmpty=False, Tree=flatten(item))
sort = SortList(Keys=clean)  # -> Keys, ValuesA
item_2 = ListItem(List=sort.Keys, Index=0, Wrap=True)
gate = StreamGate(Stream=join, Gate=item_2)  # -> Target0, Target1
read = ReadJSON(Object=gate.Target0, Key="features")
gkeys_2 = GETKEYS(object=read)  # -> simplify(value)
python = PythonScript(x=read)  # -> out, a
# ---------- python: Python ----------
import json

t = json.loads(x)

a = t
# ---------- end python ----------
python_2 = PythonScript(x=python.a)  # -> a
# ---------- python_2: Python ----------
import json
a = json.dumps(x)
# ---------- end python_2 ----------
filter = StreamFilter(Gate=item_2, Stream0=python_2, Stream1=gate.Target1)
read_2 = ReadJSON(Object=filter, Key="geometry")  # -> simplify(Value)
read_3 = ReadJSON(Object=filter, Key="properties")  # -> simplify(Value)
gkeys_3 = GETKEYS(object=read_3)  # -> simplify(value)
gkeys_4 = GETKEYS(object=read_3)  # -> simplify(value)
read_4 = ReadJSON(Object=read_2, Key="coordinates")  # -> simplify(graft(Value))
read_5 = ReadJSON(Object=read_3, Key="colour")  # -> simplify(graft(Value))
read_6 = ReadJSON(Object=read_3, Key="height")  # -> simplify(graft(Value))
read_7 = ReadJSON(Object=read_3, Key="base_height")  # -> simplify(graft(Value))
read_8 = ReadJSON(Object=read_3, Key=gkeys_4)
split = TextSplit(Text=read_4, Separators=",")
panel_2 = Panel(read_6)
rep = ReplaceText(Text=split, Find="[", RecursiveReplace=False)
rep_2 = ReplaceText(Text=rep, Find="]", RecursiveReplace=False)
dispatch_2 = Dispatch(List=rep_2, DispatchPattern=[True, False])  # -> ListA, ListB
number_slider = Slider(100000, range=0..100000)
multiplication = Multiplication(A=dispatch_2.ListA, B=number_slider)
multiplication_2 = Multiplication(A=dispatch_2.ListB, B=number_slider)
pt = ConstructPoint(XCoordinate=multiplication, YCoordinate=multiplication_2, ZCoordinate=0)
lng = ListLength(List=pt)
Z = UnitZ(Factor=read_6)
larger = LargerThan(FirstNumber=lng, SecondNumber=2)  # -> LargerThan, OrEqualTo
addition = Addition(A=read_7, B=0)
pline = PolyLine(Vertices=pt, Closed=larger.LargerThan)
crv = Curve(pline)
Z_2 = UnitZ(Factor=addition)
Z_3 = UnitZ(Factor=read_6)
move = Move(Geometry=crv, Motion=Z)  # -> simplify(Geometry), Transform
move_2 = Move(Geometry=crv, Motion=Z_2)  # -> simplify(Geometry), Transform
extr = Extrude(Base=move_2.Geometry, Direction=Z_3)
loft = Loft(
    Curves=[move_2.Geometry, move.Geometry],
    Options={Adjust=False, Closed=False, LoftEnds=0, LoftSimp=0, LoftType=0, Rebuild=10, Refit=0.01})
cap = CapHoles(Brep=loft)
null = NullItem(Item=cap)  # -> NullFlags, InvalidFlags, Description
clean_2 = CleanTree(RemoveNulls=True, RemoveInvalid=True, RemoveEmpty=False, Tree=cap)
dispatch_3 = Dispatch(List=loft, DispatchPattern=null.NullFlags)  # -> ListA, ListB
merge = Merge(Data1=clean_2, Data2=dispatch_3.ListA)
K = Text(gkeys_4)
B = Brep(merge)
P = Curve(move_2.Geometry)
C = Text(read_5)
K_2 = Data(K)
V = Data(read_8)
P_2 = ClusterOutput(P)
B_2 = ClusterOutput(B)
C_2 = ClusterOutput(C)
V_2 = ClusterOutput(V)
K_3 = ClusterOutput(K_2)

# ==== cluster DeconstructExtrusion011
brep = ClusterInput()
brep_2 = Brep(simplify(graft(brep)))
project = Project(Geometry=brep_2, Plane=PlaneXY(0, 0, 0))  # -> Geometry, Transform
crv = Curve(project.Geometry)
null = NullItem(Item=crv)  # -> NullFlags, InvalidFlags, Description
debrep = DeconstructBrep(Brep=brep_2)  # -> Faces, Edges, Vertices
dispatch = Dispatch(List=brep_2, DispatchPattern=null.NullFlags)  # -> ListA, ListB
debrep_2 = DeconstructBrep(Brep=dispatch.ListA)  # -> Faces, Edges, Vertices
area = Area(Geometry=debrep_2.Faces)  # -> Area, Centroid
pdecon = Deconstruct(Point=area.Centroid)  # -> XComponent, YComponent, ZComponent
pdecon_2 = Deconstruct(Point=debrep.Vertices)  # -> XComponent, YComponent, ZComponent
merge = Merge()
sort = SortList(Keys=pdecon.ZComponent, ValuesB=debrep.Faces)  # -> Keys, reverse(ValuesB)
sort_2 = SortList(Keys=pdecon_2.ZComponent)  # -> Keys, ValuesB
item = ListItem(List=sort.ValuesB, Index=0, Wrap=True)
dispatch_2 = Dispatch(List=crv, DispatchPattern=null.NullFlags)  # -> ListA, ListB
num = Number(null.NullFlags)
item_2 = ListItem(List=sort_2.Keys, Index=0, Wrap=True)  # -> Item1, Item
crv_2 = Curve(item)
weave = Weave(Pattern=null.NullFlags, Stream0=simplify(crv), Stream1=simplify(crv_2), NullGaps=False)
subtraction = Subtraction(A=item_2.Item1, B=item_2.Item)
H = Data(simplify(flatten(subtraction)))
bh = Data(simplify(flatten(item_2.Item)))
Z = UnitZ(Factor=bh)

# ---- group: Cluster Output
H_2 = ClusterOutput(H)

# ----
bh_2 = ClusterOutput(bh)
W = ClusterOutput(weave)

# ==== cluster PointsToCoordinates
P = ClusterInput()
pt2num = PointsToNumbers(Points=graft(P), Mask=4)
division = Division(A=pt2num, B=Slider(100000, range=0..100000))
expression = Expression(x=division, Expression="format(\"{0}\",x)")
item = ListItem(List=expression, Index=0, Wrap=True)  # -> Item, Item1, Item2
num = Number(item.Item2)  # disabled
merge = Merge(Data1=item.Item, Data2=item.Item1, Data3=num)
wrapper = Wrapper(wrap="[", content=merge, join=",")  # -> simplify(wrapped)
utrim = UberTrim(data=wrapper, bool=Toggle(True))
wrapper_2 = Wrapper(wrap="[", content=utrim, join=",")
rep = ReplaceText(Text="\"coordinates\": [█]", Find="█", Replace=wrapper_2, RecursiveReplace=False)  # -> simplify(Result)
R = ClusterOutput(rep)

# ==== cluster GETKEYS: Return keys from JSON object
object = ClusterInput()  # JSON object to read from
python = PythonScript(x=graft(object))  # -> a
# ---------- python: Python ----------
import json

object = json.loads(x)
jObject = object
a =jObject
# ---------- end python ----------
value = ClusterOutput(python)  # Value output

# ==== cluster UberTrim: Better version of Trim
data = ClusterInput()
bool = ClusterInput()
data_2 = Data(data)
trim = TrimTree(Tree=data_2, Depth=1)
null = NullItem(Item=trim)  # -> NullFlags, InvalidFlags, Description
dispatch = Dispatch(List=data_2, DispatchPattern=null.NullFlags)  # -> ListA, ListB
bool_2 = Boolean(bool)
trim_2 = TrimTree(Tree=dispatch.ListB, Depth=1)
bool_3 = Boolean(invert(null.NullFlags))
flatten = FlattenTree(Tree=dispatch.ListA, Path="{0}")
merge = Merge(Data1=flatten, Data2=trim_2)
panel = Panel(null.NullFlags)
trim_3 = TrimTree(Tree=data_2, Depth=bool_3)
bool_4 = Boolean(invert(bool_2))
data_3 = Data(trim_3)
dispatch_2 = Dispatch(List=merge, DispatchPattern=bool_4)  # -> ListA, ListB
dispatch_3 = Dispatch(List=data_3, DispatchPattern=bool_2)  # -> ListA, ListB
clean = CleanTree(RemoveNulls=True, RemoveInvalid=True, RemoveEmpty=True, Tree=dispatch_3.ListB)
clean_2 = CleanTree(RemoveNulls=True, RemoveInvalid=True, RemoveEmpty=True, Tree=dispatch_2.ListB)
merge_2 = Merge(Data1=clean, Data2=clean_2)
R = ClusterOutput(merge_2)
panel_2 = Panel(merge_2)

# ==== cluster Wrapper: Wraps data with a wrapping character
join = ClusterInput()  # Join character
content = ClusterInput()  # Content to be wrapped
wrap = ClusterInput()  # Wrap character or XML tag
txt = Text(join)
null = NullItem(Item=txt)  # -> NullFlags, InvalidFlags, Description
data = Data(content)
tmatch = MatchText(Text=wrap, RegEx="<*.>", Case=True)
bool = Boolean(null.NullFlags)
dispatch = Dispatch(List=data, DispatchPattern=bool)  # -> ListA, ListB
item = ListItem(List=wrap, Index=0, Wrap=True)
split = TextSplit(Text=item, Separators=" ")
join_2 = TextJoin(Text=dispatch.ListB, Join=txt)
panel = Panel("""{
[
(
"
'""")
panel_2 = Panel("""{█}
[█]
(█)
"█"
'█'""")
item_2 = ListItem(List=split, Index=0, Wrap=True)
weave = Weave(Pattern=bool, Stream0=join_2, Stream1=dispatch.ListA, NullGaps=False)
data_2 = Data(wrap)
replace = ReplaceMembers(Set=data_2, Find=panel, Replace=panel_2)
rep = ReplaceText(Text=item_2, Find="<", Replace="</", RecursiveReplace=False)
expression = Expression(x=item, y=rep, Expression="Format(\"{0}█{1}>\", x, y)")
rep_2 = ReplaceText(Text=expression, Find=">>", Replace=">", RecursiveReplace=False)
weave_2 = Weave(Pattern=tmatch, Stream0=replace, Stream1=rep_2, NullGaps=False)
rep_3 = ReplaceText(Text=weave_2, Find="█", Replace=weave, RecursiveReplace=False)
data_3 = Data(rep_3)
wrapped = ClusterOutput(data_3)  # Wrapped Output
